# Grasshopper definition Box Tracer.gh (Grasshopper 1.0.7)
# plug-ins: RhinoCodePluginGH

dom = ConstructDomain(DomainStart=Slider(0, range=0..200), DomainEnd=Slider(174.76, range=0..200))
dom_2 = ConstructDomain(DomainStart=Slider(0, range=0..200), DomainEnd=Slider(442.72, range=0..500))
xy = XYPlane(Origin=Point(0, 0, 0))
rectangle = Rectangle(Plane=xy, XSize=dom, YSize=dom_2, Radius=0)  # -> Rectangle, Length
Z = UnitZ(Factor=Slider(360, range=0..450))
extr = Extrude(Base=rectangle.Rectangle, Direction=Z)
debrep = DeconstructBrep(Brep=extr)  # -> Faces, Edges, Vertices
panel = Panel(debrep.Vertices)
points = PointList(Points=debrep.Vertices, Size=30)
item = ListItem(List=panel, Index=0, Wrap=True)  # -> Item, Item1, Item2, Item3, Item4, Item5, Item6, Item7
S = Script(p0=item.Item, p1=item.Item1, p2=item.Item2, p3=item.Item3, p4=item.Item4, p5=item.Item5, p6=item.Item6, p7=item.Item7)  # -> out, a; inputs p0: Point3d, p1: Point3d, p2: Point3d, p3: Point3d, p4: Point3d, p5: Point3d, p6: Point3d, p7: Point3d
# ---------- S: Python ----------
first line can be p0 to p4 or p0 to p5 or p1 to p5 or p1 to p4

if first line is p0 to p4 or p1 to p4:
second line can be p4 to p5 or p4 to p7 or p4 to p6 or
p4 to p3

if first line is p0 to p5 or p1 to p5:
second line can be p5 to p4 or p5 to p7 or p5 to p6 
or p5 to p2
################

if second line is p4 to p5:
third line can be p5 to p7 or p5 to p2 or p5 to p6

if second line is p4 to p7:
third line can be p7 to p6 or p7 to p3 or p7 to p2

if second line is p4 to 06:
third line can be p6 to p7 or p6 to p2 or p6 to p3

if second line is p4 to p3:
third line can be p7 to p3 or p7 to p6 or p7 to p2

if second line is p5 to p4:
third line can be p4 to p7 or p4 to p6 or p4 to p3

if second line is p5 to p7:
third line can be p7 to p3 or p7 to p6 or p7 to p2

if second line is p5 to p6:
third line can be p6 to p7 or p6 to p2 or p6 to p3

if second line is p5 to p2:
third line can be p2 to p6 or p2 to p7 or p2 to p3
################

if third line is p5 to p7:
fourth line can be p7 to p6 or p7 to p3 or p7 to p2

if third line is p5 to p2:
fourth line can be p2 to p6 or p2 to p3 or p2 to p7

if third line is p5 to p6:
fourth line can be p6 to p2 or p6 to p7 or p6 to p3

if third line is p7 to p6:
fourth line can be p6 to p2 or p6 to p7 or p6 to p3

if third line is p7 to p3:
fourth line can be p3 to p2 or p3 to p6 or end

if third line is p7 to p2:
fourth line can be p2 to p6 or p2 to p3 or end

if third line is p6 to p7:
fourth line can be p7 to p3 or p7 to p2

if third line is p6 to p2:
fourth line can be p2 to p3 or p2 to p7 or end

if third line is p6 to p3:
fourth line can be p3 to p2 or p3 to p7 or end

if third line is p7 to p3:
fourth line can be p3 to p2 or p3 to p6 or end

if third line is p4 to p7:
fourth line can be p7 to p6 or p7 to p3 or p7 to p2

if third line is p4 to p6:
fourth line can be p6 to p2 or p6 to p3 or p6 to p6 tp p7

if third line is p4 to p3:
fourth line can be p3 to p7 or p3 to p6 or p3 to p2

if third line is p2 to p6:
fourth line can be p6 to p7 or p6 to p3 or end

if third line is p2 to p3:
fourth line can be p3 to p7 or p3 to p6

if third line is p2 to p7:
fourth line is p7 to p3
################

if fourth line is p7 to p6:
fifth line can be p6 to p3 or p6 to p2

if fourth line is p7 to p3:
fifth line can be p3 to p6 or p3 to p2 or end

if fourth line is p7 to p2:
fifth line can be p2 to p3 or p2 to p6 or end

if fourth line is p2 to p6:
fifth line can be p6 to p7 or p6 to p3 or end

if fourth line is p2 to p3
fifth line can be p3 to p7 or p3 to p6 or end

if fourth line is p2 to p7
fifth line can be p7 to p3 or p7 to p6 or end

if fourth line is p3 to p2
fifth line can be p2 to p6 or p2 to p7 

if fourth line is p3 to p6
fifth line can be p6 to p2 or p6 to p7 or end


if fourth line is p6 to p2
fifth line can be p2 to p3 or p2 to p7 or end 

if fourth line is p6 to p3 
fifth line can be p3 to p2 or p3 to p7 or end

if fourth line is p3 to p7 
fifth line can be p7 to p6 or p7 to p2 or end
# ---------- end S ----------
panel_2 = Panel(S.a)
